# Grasshopper definition 2d_gcode_generator.gh (Grasshopper 0.9.64)
# plug-ins: Firefly_X

# ---- group: Specific Gcode Taste for Hyun's Machine Only (keep all at 0)
z_offset_usually_0_8mm = Slider(0, range=0..2)
z_lift_height_while_feeding_1_8mm = Slider(0, range=0..2)
z_lift_speed_while_feeding_2000 = Slider(0, range=0..10000)
z_lift_interval_in_mm = Slider(0, range=0..100)

# ----
resolution_2_do_not_change = Slider(2, range=0.4..3)
disregard_points_less_than = Slider(2, range=1..10)
num = Number(z_lift_interval_in_mm)
repeat = RepeatData(Data=Toggle(True), Length=expr("L-1", num))  # -> flatten(Data)
panel = Panel("Format(\"{0:G1 X0.00 }{1:Y0.00 }{2:Z0.00 }{3: F0000}\",x,y,z,u)")
bool = Boolean([repeat, Toggle(True)])
pt = ConstructPoint(XCoordinate=0, YCoordinate=0, ZCoordinate=Slider(15, range=0..100))
pt_2 = ConstructPoint(XCoordinate=0, YCoordinate=0, ZCoordinate=Slider(15, range=0..100))
num_2 = Number(z_offset_usually_0_8mm)
num_3 = Number(z_lift_speed_while_feeding_2000)
pdecon = Deconstruct(Point=pt)  # -> XComponent, YComponent, ZComponent
num_4 = Number(z_lift_height_while_feeding_1_8mm)
pdecon_2 = Deconstruct(Point=pt_2)  # -> XComponent, YComponent, ZComponent
panel_2 = Panel("Format(\"{0:G1 X0.00 }{1:Y0.00 }{2:Z0.00 } {3: F0000}\",x,y,z,u)")
start_gcode = Panel("""G92 X0 Y0 Z0
M302""")

# ---- group: Control Panel
width_in_mm = Slider(200, range=0..600)
contour_sparsity = Slider(4, range=1..20)
feedrate_mm_min = Slider(6000, range=0..12000)
travel_speed_mm_min = Slider(12000, range=0..15000)
# If you want to create gcode from curves of your own,
# disconnect "contour" from "input curves" and
# right click on "input curves" then select 'set
# one curve' or 'set multiple curves'.
z_clearance_in_mm = Slider(3, range=1..30)

# ----
clearance = Number(z_clearance_in_mm)
travel_speed = Number(travel_speed_mm_min)
eval = Evaluate(F=panel, x=pdecon.XComponent, y=pdecon.YComponent, z=clearance, u=travel_speed)
eval_2 = Evaluate(F=panel, x=pdecon_2.XComponent, y=pdecon_2.YComponent, z=clearance, u=travel_speed)
panel_3 = Panel(eval)
panel_4 = Panel(eval_2)
num_5 = Number(feedrate_mm_min)

# ---- group: Contour Generator
video_stream = WebCamVideoStream()
multiplication = Multiplication(A=width_in_mm, B=Slider(0.75, range=0..1))
xy = XYPlane(Origin=Point(0, 0, 0))
rectangle = Rectangle(Plane=xy, XSize=width_in_mm, YSize=multiplication, Radius=0)  # -> Rectangle, Length
mesh = MeshFromImage(Bmp=video_stream, Sx=width_in_mm, Sy=multiplication, Z=Slider(10, range=0..10), C=False)
pt_3 = ConstructPoint(XCoordinate=0, YCoordinate=0, ZCoordinate=0)
Z = UnitZ(Factor=1)
contour = Contour(Shape=mesh, Point=pt_3, Direction=Z, Distance=contour_sparsity)
xy_2 = XYPlane(Origin=Point(0, 0, 0))
simplify = SimplifyCurve(Curve=contour)  # -> Curve, Simplified
project = Project(Geometry=simplify.Curve, Plane=xy_2)  # -> Geometry, Transform
contour_connect_to_input_curves_on_contr = Curve(project.Geometry)  # "Contour (connect to \"input curves\" on control panel)"

# ---- group: Control Panel (continued)
input_curves_connects_to_contour_on_cont = Curve(contour_connect_to_input_curves_on_contr)  # "INPUT CURVES (connects to \"contour\" on contour generator panel"

# ---- group: Contour Generator (continued)
boundary = BoundarySurfaces(Edges=input_curves_connects_to_contour_on_cont)

# ----
divlength = DivideLength(Curve=flatten(input_curves_connects_to_contour_on_cont), Length=resolution_2_do_not_change)  # -> Points, Tangents, Parameters

# ---- group: Dimensions Tag
explode = Explode(Curve=rectangle.Rectangle, Recursive=True)  # -> Segments, Vertices
boundary_2 = BoundarySurfaces(Edges=rectangle.Rectangle)
item = ListItem(List=explode.Segments, Index=0, Wrap=True)
item_2 = ListItem(List=explode.Segments, Index=3, Wrap=True)
curvepoint = PointOnCurve(item, parameter=0.5)
curvepoint_2 = PointOnCurve(item_2, parameter=0.5)
rad = Radians(Degrees=90)
xy_3 = XYPlane(Origin=curvepoint_2)
dim = Dimensions(Surface=boundary_2)  # -> UDimension, VDimension
xy_4 = XYPlane(Origin=curvepoint)
xy_5 = XYPlane(Origin=Point(0, 0, 0))
int = Integer(dim.VDimension)
int_2 = Integer(dim.UDimension)
rotate = Rotate(Geometry=xy_3, Angle=rad, Plane=xy_3)  # -> Geometry, Transform
tag = TextTag3D(Location=xy_5, Text="Origin__", Size=15, Justification=9)
tag_2 = TextTag3D(Location=xy_4, Text=int_2, Size=25, Justification=1)
tag_3 = TextTag3D(Location=rotate.Geometry, Text=int, Size=25, Justification=7)

# ----
lng = ListLength(List=divlength.Points)
equals = Equality(FirstNumber=disregard_points_less_than, SecondNumber=lng)  # -> simplify(Equality), Inequality
cull = CullPattern(List=divlength.Points, CullPattern=equals.Inequality)
intcrv = Interpolate(Vertices=cull, Degree=3, Periodic=False, KnotStyle=1)  # -> Curve, Length, Domain
end = EndPoints(Curve=intcrv.Curve)  # -> Start, End
end_points = Panel(end.End)
start_points = Panel(end.Start)
cull_2 = CullPattern(List=cull, CullPattern=bool)
pdecon_3 = Deconstruct(Point=divlength.Points)  # -> XComponent, YComponent, ZComponent
pdecon_4 = Deconstruct(Point=end.End)  # -> XComponent, YComponent, ZComponent
pdecon_5 = Deconstruct(Point=end.Start)  # -> XComponent, YComponent, ZComponent
eval_3 = Evaluate(F=panel, x=pdecon_4.XComponent, y=pdecon_4.YComponent, z=clearance, u=travel_speed)
eval_4 = Evaluate(F=panel, x=pdecon_5.XComponent, y=pdecon_5.YComponent, z=clearance, u=travel_speed)
pt_4 = ConstructPoint(XCoordinate=pdecon_3.XComponent, YCoordinate=pdecon_3.YComponent, ZCoordinate=0)
panel_5 = Panel(eval_4)
panel_6 = Panel(eval_3)
cullpt = CullDuplicates(Points=[pt_4, cull_2], Tolerance=0, CullMode=2)  # -> Points, Indices, Valence
cull_i = CullIndex(List=pt_4, Indices=cullpt.Indices, Wrap=True)
lng_2 = ListLength(List=flatten(eval_3))  # -> expr("L-1", Length)
index = ItemIndex(List=pt_4, Item=cull_i)  # -> expr("i+1", Index)
split = SplitList(List=flatten(eval_4), Index=1)  # -> graft(ListA), graft(ListB)
addition = Addition(A=pdecon_3.ZComponent, B=num_2)
split_2 = SplitList(List=flatten(eval_3), Index=lng_2)  # -> graft(ListA), graft(ListB)
pdecon_6 = Deconstruct(Point=cull_i)  # -> XComponent, YComponent, ZComponent
weave = Weave(Pattern=[0, 1], Stream0=eval, Stream1=split.ListA, NullGaps=False)  # -> flatten(Weave)
weave_2 = Weave(Pattern=[0, 1], Stream0=eval_3, Stream1=split.ListB, NullGaps=False)
weave_3 = Weave(Pattern=[0, 1], Stream0=split_2.ListB, Stream1=eval_2, NullGaps=False)  # -> flatten(Weave)
eval_5 = Evaluate(F=panel_2, x=pdecon_3.XComponent, y=pdecon_3.YComponent, z=addition, u=num_5)
addition_2 = Addition(A=index)
eval_6 = Evaluate(F=panel_2, x=pdecon_6.XComponent, y=pdecon_6.YComponent, z=num_4, u=num_3)
eval_7 = Evaluate(F=panel_2, x=pdecon_6.XComponent, y=pdecon_6.YComponent, z=num_2, u=num_3)
panel_7 = Panel(weave)
panel_8 = Panel(weave_2)
panel_9 = Panel(weave_3)
sort = SortList(Keys=[index, addition_2])  # -> Keys, ValuesA
weave_4 = Weave(Pattern=[0, 1], Stream0=eval_6, Stream1=eval_7, NullGaps=False)
int_3 = Integer(sort.Keys)
ins = InsertItems(List=eval_5, Item=weave_4, Indices=int_3, Wrap=True)
rep = ReplaceString(String=ins, Find="-G1 X", Replace="G1 X-", RecursiveReplace=False)
rep_2 = ReplaceString(String=rep, Find="-Y", Replace="Y-", RecursiveReplace=False)
lng_3 = ListLength(List=rep_2)
ins_2 = InsertItems(List=rep_2, Item=weave_2, Indices=lng_3, Wrap=True)  # -> flatten(List)
txt = Text([panel_7, ins_2, weave_3])
# Resulting Gcode.
# 
# Right click on the yellow "output" panel and
# 
# click 'stream destination', and name it as "***.gcode"
# 
# then right click again on the "output" panel,
# 
# making sure 'stream contents' is enabled.
ins_3 = InsertItems(List=txt, Item=start_gcode, Indices=0, Wrap=True)
output = Panel(ins_3)
